# Dynamo graph Copy filters from a view template to another view template.dyn (Dynamo 2.19.3.6394)

# group: 02. Select target view
# Descripción <Haga doble clic aquí para editar la descripción del grupo>
select_target_view = Views("TECHNICAL ROOM A - ALL SYSTEMS - FLOOR PLAN Copia 2")

# group: 01. Select source view
# Descripción <Haga doble clic aquí para editar la descripción del grupo>
select_source_view = Views("TECHNICAL ROOM A - ALL SYSTEMS - FLOOR PLAN")

# group: View that was selected
# Descripción <Haga doble clic aquí para editar la descripción del grupo>
code_block = CodeBlock(sourceView=select_source_view)
# ---------- code_block.designscript (2 lines) ----------
/*The view that has the filters*/
_sourceView: var[]..[];
# ----------------------------------------

# group: View that was selected
# Descripción <Haga doble clic aquí para editar la descripción del grupo>
code_block_2 = CodeBlock()  # unwired: targetViews
# ---------- code_block_2.designscript (2 lines) ----------
/*Views to apply filters*/
_targetViews: var[]..[];
# ----------------------------------------

# group: 03. Engine
# Descripción <Haga doble clic aquí para editar la descripción del grupo>
python_script = Python(IN[0]=code_block, IN[1]=code_block_2)  # IronPython2
# ---------- python_script.python (77 lines) ----------
# Developed by C2A Services - BIM Specialist Marcos Cisterna

import clr

# Load Revit API
clr.AddReference('RevitAPI')
from Autodesk.Revit.DB import *
import Autodesk

# Load document reference
clr.AddReference("RevitServices")
import RevitServices
from RevitServices.Persistence import DocumentManager
from RevitServices.Transactions import TransactionManager

def toList(input):
    """Return iterable if available, a list of 1 otherwise"""
    if hasattr(input, "__iter__") and not isinstance(input, str):  # Cambié basestring por str
        return input
    else:
        return [input]

# Documento activo
doc = DocumentManager.Instance.CurrentDBDocument

# Obtener la vista fuente y las vistas objetivo
sourceView = UnwrapElement(IN[0])
targetViews = toList(UnwrapElement(IN[1]))

# Verificar si la vista fuente es válida
if sourceView is None:
    raise ValueError("La vista fuente (sourceView) no es válida. Asegúrate de que se ha proporcionado una vista válida.")

# Obtener los filtros de la vista fuente
sourceViewFiltersId = sourceView.GetFilters()
filters = [doc.GetElement(id) for id in sourceViewFiltersId]
filtersOverrides = [sourceView.GetFilterOverrides(f.Id) for f in filters]
filtersVisibility = [sourceView.GetFilterVisibility(f.Id) for f in filters]

# Listas para almacenar plantillas exitosas y vistas sin plantillas
fList = []
eList = []

# Iniciar la transacción
TransactionManager.Instance.EnsureInTransaction(doc)

for tV in targetViews:
    try:
        # Comprobar si la vista tiene una plantilla de vista aplicada
        targetTemplateId = tV.ViewTemplateId
        if targetTemplateId != ElementId.InvalidElementId:
            # Si la vista tiene una plantilla, trabajar directamente con la plantilla
            targetTemplate = doc.GetElement(targetTemplateId)
            if targetTemplate is not None:
                # Aplicar filtros a la plantilla de vista
                for f, override, visibility in zip(filters, filtersOverrides, filtersVisibility):
                    if not targetTemplate.IsFilterApplied(f.Id):
                        targetTemplate.AddFilter(f.Id)
                    targetTemplate.SetFilterOverrides(f.Id, override)
                    targetTemplate.SetFilterVisibility(f.Id, visibility)
                
                # Añadir la plantilla a la lista de éxito
                fList.append(targetTemplate)
        else:
            # Si la vista no tiene plantilla, añadir a la lista de error
            eList.append(tV)
    except Exception as e:
        # Log o print de error para depuración
        import traceback
        print("Error applying filters to view template for view {}: {}".format(tV.Id, traceback.format_exc()))
        eList.append(tV)

# Finalizar la transacción
TransactionManager.Instance.TransactionTaskDone()

# Salida
OUT = [fList, eList]
# ----------------------------------------
code_block_3 = CodeBlock(l=python_script) { l[0]; l[1]; }

# group: 04. Views in which was applied changes
# Descripción <Haga doble clic aquí para editar la descripción del grupo>
code_block_4 = CodeBlock(views=code_block_3.out0) { _views; }
watch = Watch(code_block_4)

# group: 05. Errors in views
# Descripción <Haga doble clic aquí para editar la descripción del grupo>
code_block_5 = CodeBlock(errorviews=code_block_3.out1) { _errorviews; }
watch_2 = Watch(code_block_5)

# group: Optional: Select list of views
# Descripción <Haga doble clic aquí para editar la descripción del grupo>
views = Views("TECHNICAL ROOM A - ALL SYSTEMS - FLOOR PLAN Copia 1")
views_2 = Views("TECHNICAL ROOM A - ALL SYSTEMS - FLOOR PLAN Copia 2")
views_3 = Views("TECHNICAL ROOM A - ALL SYSTEMS - FLOOR PLAN Copia 3")
views_4 = Views("TECHNICAL ROOM A - ALL SYSTEMS - FLOOR PLAN Copia 4")
list_create = List.Create(item0=views, item1=views_2, item2=views_3, item3=views_4)
