# Dynamo graph CopyPasteTextParameters.dyn (Dynamo 2.19.3.6394)

# group: 1. Elements Category
# Do not edit
categories = Categories("OST_LightingFixtures")  # graph input
all_elements_of_category = ElementsOfCategory(Category=categories)

# group: All family's parameters
# Do not edit
parameters = Element.Parameters(element=all_elements_of_category)

# group: 3. Parameter Name to Paste
# note: Only "Comments", "Mark" Parameters or text based parameters
string = StringInput("Comments")  # graph input

# group: 2. Parameter Name to copy
# note: Only "Description", "URL", "Manufacturer", "Keynote", "Type Comments" "Category";
string_2 = StringInput("Description")  # graph input

# group: Source of information elements
# Do not edit
elementType = Element.ElementType(element=all_elements_of_category)
getParameterValueByName = Element.GetParameterValueByName(element=elementType, parameterName=string_2)
string_from_object = FromObject(obj=getParameterValueByName)

# group: 4. Engine
# Do not edit
setParameterByName = Element.SetParameterByName(element=all_elements_of_category, parameterName=string, value=string_from_object)
