# Dynamo graph Delete Imported Line Patterns with IMPORT words beggins.dyn (Dynamo 2.12.1.8246)

element_types = ElementTypes("LinePatternElement")
all_elements_of_type = ElementsOfType(element_type=element_types)
name = Element.Name(element=all_elements_of_type)
code_block = CodeBlock { "IMPORT"; false; }
contains = String.Contains(string=name, searchFor=code_block.out0, ignoreCase=code_block.out1)
filterByBoolMask = List.FilterByBoolMask(list=all_elements_of_type, mask=contains)
delete = Element.Delete()  # unwired: element
count = List.Count(list=all_elements_of_type)
watch = Watch(count)
