# Dynamo graph RenumberMark.dyn (Dynamo 2.19.3.6394)

# group: 1. Select all elements of an category
categories = Categories("OST_MechanicalEquipment")  # graph input
all_elements_of_category = ElementsOfCategory(Category=categories)

# group: 1. Select Family type
family_types = FamilyTypes("Wall Tag:1/4\"")  # graph input

# group: 1. Name of elements to be renumbered
all_elements_of_family_type = ElementsOfFamilyType(Family_Type=family_types)

# group: Parameter name
# Must be an TEXT parameter
string = StringInput("Mark")  # graph input

# group: 2. Set a PREFIX
PREFIX = CodeBlock { "IN "; }
count = List.Count(list=all_elements_of_family_type)
code_block = CodeBlock(count=count) { 1..count; }
string_from_object = FromObject(obj=code_block)
code_block_2 = CodeBlock(a=PREFIX, b=string_from_object) { a+b; }

# group: 3. Engine
setParameterByName = Element.SetParameterByName(element=all_elements_of_family_type, parameterName=string, value=code_block_2)
