# Dynamo graph Set North and East for any element.dyn (Dynamo 2.19.3.6394)
# packages: InfraBIM 0.0.2

select_model_element = DSModelElementSelection()  # 1 picked in the model
string = StringInput("X Coordinate")
parameterByName = Parameter.ParameterByName(element=select_model_element, name=string)
getLocation = Element.GetLocation(element=select_model_element)
code_block = CodeBlock(a=getLocation) { a.X; a.Y; a.Z; }
transfrom_Revit_out = Custom[Transfrom_Revit_out](code_block.out0, code_block.out1, code_block.out2)  # package InfraBIM; Transforms Revit points to Real world coordinate by matrix transform rotation about the Project basepoint and True North Rotation. Adds Revit Project Basepoint coordinates Used to export point from Revit Adds Revit Project Basepoint coordinates Used to export point from Revit Used to export point from Revit

# group: X Value
setValue = Parameter.SetValue(parameter=parameterByName, value=transfrom_Revit_out.Base_Point_X)

string_2 = StringInput("Y Coordinate")
parameterByName_2 = Parameter.ParameterByName(element=select_model_element, name=string_2)

# group: Y Value
setValue_2 = Parameter.SetValue(parameter=parameterByName_2, value=transfrom_Revit_out.transform_Y)

string_3 = StringInput("Z Coordinate")
parameterByName_3 = Parameter.ParameterByName(element=select_model_element, name=string_3)

# group: Z Value
setValue_3 = Parameter.SetValue(parameter=parameterByName_3, value=transfrom_Revit_out.transform_Z)
