# Dynamo graph Set North and East for type element.dyn (Dynamo 2.19.3.6394)
# packages: InfraBIM 0.0.2

family_types = FamilyTypes("FES_MEP_PE_ELECTROFUSION_CONICAL_REDUCER_PFT_00:PE ELECTROFUSION-CONICAL REDUCER")
all_elements_of_family_type = ElementsOfFamilyType(Family_Type=family_types)
getLocation = Element.GetLocation(element=all_elements_of_family_type)
code_block = CodeBlock(a=getLocation) { a.X; a.Y; a.Z; }
transfrom_Revit_out = Custom[Transfrom_Revit_out](code_block.out0, code_block.out1, code_block.out2)  # package InfraBIM; Transforms Revit points to Real world coordinate by matrix transform rotation about the Project basepoint and True North Rotation. Adds Revit Project Basepoint coordinates Used to export point from Revit Adds Revit Project Basepoint coordinates Used to export point from Revit Used to export point from Revit

# group: Z Parameters
string = StringInput("FES_Z COORDINATE")
parameterByName = Parameter.ParameterByName(element=all_elements_of_family_type, name=string)
setValue = Parameter.SetValue(parameter=parameterByName, value=transfrom_Revit_out.transform_Z)

# group: X Parameters
string_2 = StringInput("FES_X COORDINATE")
parameterByName_2 = Parameter.ParameterByName(element=all_elements_of_family_type, name=string_2)
setValue_2 = Parameter.SetValue(parameter=parameterByName_2, value=transfrom_Revit_out.transform_X)

# group: Y Parameters
string_3 = StringInput("FES_Y COORDINATE")
parameterByName_3 = Parameter.ParameterByName(element=all_elements_of_family_type, name=string_3)
setValue_3 = Parameter.SetValue(parameter=parameterByName_3, value=transfrom_Revit_out.transform_Y)
