# Dynamo graph Split Walls By Selecting Level.dyn (Dynamo 2.16.2.5624)

# note: IMPORTANT:
# What the script actually does is create two walls from the one that already exists and eliminates the previous one.
# The parameters of comments, level offsets, and assigned level, structural function (instance parameters) are respected and copied to the created walls; with the exception of the Mark parameter.
# If you hide walls with the HH tool, the walls will be cut the same.
# If you use the Section Box tool, only those that are visible will be cut.
# The stacked walls may not have the desired results.
# note: Created for Revit 2023.1.3

# group: Boolean order
# Do not edit
boolean = BoolSelector(true)  # graph input
code_block = CodeBlock(Run=boolean) { Run; }

# group: Option 1 - Select walls in current view > Selecting all elements in active view
# Re-load in case that doesn't functioning
all_elements_in_active_view = ElementsInView()

# group: Option 1 - Select walls in current view > Lists of elements
# Do not edit
string_from_object = FromObject(object=all_elements_in_active_view)
flatten = List.Flatten(list=string_from_object)

# group: Option 1 - Select walls in current view > Select category to mantain
# Do not edit
categories = Categories("OST_Walls")  # graph input
all_elements_of_category = ElementsOfCategory(Category=categories)
string_from_object_2 = FromObject(object=all_elements_of_category)

# group: Option 1 - Select walls in current view > Filter elements by Boolean Mask
# Do not edit
contains = String.Contains(string=flatten, searchFor=string_from_object_2)
filterByBoolMask = List.FilterByBoolMask(list=all_elements_in_active_view, mask=contains)

# group: Option 1 - Select walls in current view
# Elements to be cut in current view
watch = Watch(filterByBoolMask.in)

# group: Choose level to cut geometry
# You can create a level and then delete it after running the script
levels = Levels("Level 04 - T.O. Fnd. Wall")

# group: Results
# Elements already cut in the current view
wall_python_script = Python(IN[0]=code_block, IN[1]=watch, IN[2]=levels)  # IronPython2
# ---------- wall_python_script.python (91 lines) ----------
import clr

clr.AddReference("RevitServices")
from RevitServices.Persistence import DocumentManager
from RevitServices.Transactions import TransactionManager
doc = DocumentManager.Instance.CurrentDBDocument

clr.AddReference("RevitNodes")
import Revit
clr.ImportExtensions(Revit.Elements)
clr.ImportExtensions(Revit.GeometryConversion)

clr.AddReference("RevitAPI")
from Autodesk.Revit.DB import *

############## Definitions Start ##############
# Convert to List if singleton...
def tolist(obj1):
    if hasattr(obj1,"__iter__"): 
        return obj1
    else: 
        return [obj1]

# Create a new wall segment from the base to the target level
def CreateWallSegment(wall, base_level, top_level):
    new_wall = None
    try:
        # Copiar el muro original
        new_wall_id = ElementTransformUtils.CopyElement(doc, wall.Id, XYZ(0, 0, 0))[0]
        new_wall = doc.GetElement(new_wall_id)

        # Ajustar la restricción base
        base_param = new_wall.get_Parameter(BuiltInParameter.WALL_BASE_CONSTRAINT)
        base_param.Set(base_level.Id)

        # Ajustar la restricción superior
        top_param = new_wall.get_Parameter(BuiltInParameter.WALL_HEIGHT_TYPE)
        top_param.Set(top_level.Id)

    except Exception as e:
        return str(e)
    
    return new_wall

############## Definitions End ##############

# IN-Variables...
run = tolist(IN[0])[0]
walls = tolist(UnwrapElement(IN[1]))
target_level = UnwrapElement(IN[2])  # Nivel seleccionado

# OUT-Variables...
outList = []

# Main Script...
if run:
    # Start a new transaction for modifying the document...
    TransactionManager.Instance.EnsureInTransaction(doc)
    
    for wall in walls:
        # Verificar que el elemento sea un muro
        if isinstance(wall, Wall):
            # Obtener los niveles base y tope del muro
            base_level_id = wall.get_Parameter(BuiltInParameter.WALL_BASE_CONSTRAINT).AsElementId()
            top_level_id = wall.get_Parameter(BuiltInParameter.WALL_HEIGHT_TYPE).AsElementId()

            base_level = doc.GetElement(base_level_id)
            top_level = doc.GetElement(top_level_id)

            # Comprobar que el nivel objetivo esté entre el nivel base y el tope
            if base_level.Elevation < target_level.Elevation < top_level.Elevation:
                # Crear un nuevo segmento del muro desde el nivel base hasta el nivel objetivo
                lower_wall = CreateWallSegment(wall, base_level, target_level)

                # Crear otro segmento del muro desde el nivel objetivo hasta el tope original
                upper_wall = CreateWallSegment(wall, target_level, top_level)

                # Agregar ambos muros a la lista de salida
                outList.append(lower_wall)
                outList.append(upper_wall)

                # Eliminar el muro original
                doc.Delete(wall.Id)

    # Finalizar la transacción
    TransactionManager.Instance.TransactionTaskDone()

    # Devolver los muros cortados
    OUT = outList
else:
    OUT = "Please Set Run to True"
# ----------------------------------------

# group: Option 2 -Single wall to be cut
# Must be connected in case you want to select a single wall for cutting
select_model_element = DSModelElementSelection()  # 1 picked in the model; graph input

# group: Option 3 - Selected walls to be cut
# Must be connected in case you want to select several walls for cutting
select_model_elements = DSModelElementsSelection()  # 1 picked in the model

# group: Option 1 - Select walls in current view > Elements don't to be cut
# Do not edit
watch_2 = Watch(filterByBoolMask.out)
