# Dynamo graph Upgrade Revit models.dyn (Dynamo 2.16.2.5624)
# packages: Rhythm 2024.10.1

directory_path = Directory("C:\Users\T26\Desktop\test ctgç")
directory_from_path = DirectoryObject(path=directory_path)
code_block = CodeBlock { "*.rvt"; false; }
getDirectoryContents = FileSystem.GetDirectoryContents(directory=directory_from_path, searchString=code_block.out0, includeSubdirectories=code_block.out1)
code_block_2 = CodeBlock { true; }
ʳʰʸᵗʰᵐ_applications = Rhythm.Revit.Application.Applications.OpenDocumentFile(filePath=getDirectoryContents.files, closeAllWorksets=code_block_2)
code_block_3 = CodeBlock { true; }
ʳʰʸᵗʰᵐ_applications_2 = Rhythm.Revit.Application.Applications.CloseDocument(document=ʳʰʸᵗʰᵐ_applications, save=code_block_3)
